# Grasshopper definition Post-work Forms.gh (Grasshopper 1.0.7)
# plug-ins: Heteroptera

# ----
# Basepoint
# - Construct base point
# - Shifts base point up to allow for base
number_slider = Slider(4, range=0..100)
Z = UnitZ(Factor=number_slider)
pt = Point(Point(0, 0, 0))
move = Move(Geometry=pt, Motion=Z)  # -> Geometry, Transform

# ----
# Base point is moved up to construct between 4 and 7 layers in the form.
# 
# The layers are contrained within a domain between 10 and a random value between100-150 on the z-axis.
# This ensure objects of varied height.
seed = SeedGenerator(Number=1)
dom = ConstructDomain(DomainStart="4", DomainEnd="7")
dom_2 = ConstructDomain(DomainStart="100", DomainEnd="150")
random = Random(Range=dom_2, Number=1, Seed=seed)
random_2 = Random(Range=dom, Number=1, Seed=seed)
dom_3 = ConstructDomain(DomainStart="10", DomainEnd=random)
random_3 = Random(Range=dom_3, Number=random_2, Seed=seed)
ins = InsertItems(List=random_3, Item="0.0", Indices=0, Wrap=True)
sort = SortList(Keys=ins)  # -> Keys, ValuesA
Z_2 = UnitZ(Factor=sort.Keys)
move_2 = Move(Geometry=move.Geometry, Motion=Z_2)  # -> Geometry, Transform

# ----
# Circle Contructor
# A circle is then constructed on each layer giving the form its basic shape.
seed_2 = SeedGenerator(Number=1)
dom_4 = ConstructDomain(DomainStart="10", DomainEnd="35")
random_4 = Random(Range=dom_4, Number=random_2, Seed=seed_2)
cir = Circle(Plane=move_2.Geometry, Radius=random_4)

# ----
# *Basemaker*
# - Extract first circle
# - Make 80% circle at base
# - Insert circle
panel = Panel("0.9")
split = SplitList(List=cir, Index=1)  # -> ListA, ListB
fragment = TextFragment(Text=split.ListA, Start=9, Count=5)
multiplication = Multiplication(A=fragment, B=panel)
# Curves are constructed and selected to include both straight and curvy connection between layers.
cir_2 = Circle(Plane=PlaneXY(0, 0, 0), Radius=multiplication)
ins_2 = InsertItems(List=cir, Item=cir_2, Indices=0, Wrap=True)

divide = DivideCurve(Curve=ins_2, Count="1", Kinks=False)  # -> Points, Tangents, Parameters

# ----
# Alle kurve-typer tegnes
# (flere typer kan tilføjes)
intcrv_t = InterpolateT(Vertices=flatten(divide.Points), Degree=3, TangentStart=Vector(0, 0, 0), TangentEnd=Vector(0, 0, 0), KnotStyle=1)  # -> Curve, Length, Domain
pline = PolyLine(Vertices=flatten(divide.Points), Closed=False)

crv_cp = CurveClosestPoint(Point=flatten(divide.Points), Curve=intcrv_t.Curve)  # -> Point, Parameter, Distance
shatter = Shatter(Curve=intcrv_t.Curve, Parameters=crv_cp.Parameter)

crv_cp_2 = CurveClosestPoint(Point=divide.Points, Curve=pline)  # -> Point, Parameter, Distance
shatter_2 = Shatter(Curve=pline, Parameters=flatten(crv_cp_2.Parameter))

# ----
# Der laves et random pattern,
# som bruges til at frasortere nogen af kurverne,
# så der aldrig ligger både en lige og en interpolate kurve oven i hinanden
# 
# Random pattern for validating that a straight and interpolate curve never overlaps
panel_2 = Panel("1")
subtraction = Subtraction(A=random_2, B=panel_2)
dom_5 = ConstructDomain(DomainStart="0", DomainEnd="100")
random_5 = Random(Range=dom_5, Number=subtraction, Seed=2)
panel_3 = Panel(random_5)
smaller = SmallerThan(FirstNumber=random_5, SecondNumber="30")  # -> SmallerThan, OrEqualTo
larger = LargerThan(FirstNumber=random_5, SecondNumber="30")  # -> LargerThan, OrEqualTo
cull = CullPattern(List=flatten(shatter_2), CullPattern=larger.OrEqualTo)
cull_2 = CullPattern(List=flatten(shatter), CullPattern=smaller.SmallerThan)

# ----
# Curves are joined and revoled to create surfaces
join = JoinCurves(Curves=[cull_2, cull], Preserve=False)
arrpolar = PolarArray(Geometry=join, Plane=PlaneXY(0, 0, 0), Count=10, Angle=6.283185307)  # -> Geometry, Transform
loft = Loft(Curves=arrpolar.Geometry, Options={Adjust=True, Closed=True, LoftEnds=0, LoftSimp=0, LoftType=0, Rebuild=10, Refit=0.01})
join_2 = BrepJoin(Breps=loft)  # -> Breps, Closed
cap = CapHoles(Brep=join_2.Breps)

rec = Rectangle({Plane=PlaneXY(0, 0, 0), Size=Domain2(u=-70..70, v=-70..70)})
ovulate = Ovulate(Geometrical=cap, Boundary=rec, Control=2)  # -> Vector, Number, Rectangle

# ----
# Shift camera target backwards
# 1 * = 1 row
number_slider_2 = Slider(140, range=0..1000)
multiplication_2 = Multiplication(A=number_slider_2, B=Slider(4, range=0..30))
pt_2 = Point(ovulate.Vector)
panel_4 = Panel(multiplication_2)
Y = UnitY(Factor=panel_4)
subtraction_2 = Subtraction(A=pt_2, B=Y)

# ----
# Camera Calculator
number_slider_3 = Slider(-109, range=-500..0)
Y_2 = UnitY(Factor=Slider(-224, range=-3000..3000))
Z_3 = UnitZ(Factor=number_slider_3)
subtraction_3 = Subtraction(A=ovulate.Vector, B=Y_2)
subtraction_4 = Subtraction(A=subtraction_3, B=Z_3)

# ----
# Text Generator
panel_5 = Panel("-50")
panel_6 = Panel(ovulate.Number)
colour = ColourPicker(PickedColour=RGB(255, 255, 255))
Y_3 = UnitY(Factor=panel_5)
subtraction_5 = Subtraction(A=ovulate.Vector, B=Y_3)
ins_3 = InsertItems(List="Day ", Item=panel_6, Indices=1, Wrap=True)
join_3 = TextJoin(Text=ins_3)
panel_7 = Panel(join_3)
textbaker = TextBaker(Location=subtraction_5, Text=panel_7, Size=Slider(13.349, range=0..100), Color=colour, Justification=7, Activate=True)

camera = CameraCrane(Location=subtraction_4, Target=subtraction_2, Lense=20, Refresh=True)  # -> Camera, Target, Lens, Up, HorizontalViewAngle, VerticalViewAngle, ScreenRatio
timer = Timer(TimerInterval=1000, Target=[seed_2, seed])  # disabled
eventswitch = EventGate(Data=panel_7)  # -> Data, IsNew
can = OilCan(DataList=eventswitch.IsNew, Reset=False, Drop=True, DropMode=0)

# ----
# Capture frame
capture = Capture(
    Activate=can,
    Path="C:\Users\sanda\Documents\Projects\Goldsmiths\Keep Turning\Vases\Images\set01",
    Filename="Capture",
    Ext=0,
    XSize=1162,
    YSize=1502,
    Reset=False)
panel_8 = Panel(capture)
